% Requirement links of HelicopterSystem.slx (R2019a)

block :1 implements HelicopterSystemRequirements.slreqx#9: SR_5 : Attitude Heading Reference System Interfaces
block :10 implements HelicopterSystemRequirements.slreqx#6: SR_2: Hydraulic Actuator Interfaces
block :10 implements HelicopterSystemRequirements.slreqx#7: SR_3: Hydraulic Actuator Signals
block :12 implements HelicopterSystemRequirements.slreqx#6: SR_2: Hydraulic Actuator Interfaces
block :12 implements HelicopterSystemRequirements.slreqx#7: SR_3: Hydraulic Actuator Signals
block :14 implements HelicopterSystemRequirements.slreqx#6: SR_2: Hydraulic Actuator Interfaces
block :14 implements HelicopterSystemRequirements.slreqx#7: SR_3: Hydraulic Actuator Signals
block :21 implements HelicopterSystemRequirements.slreqx#6: SR_2: Hydraulic Actuator Interfaces
block :21 implements HelicopterSystemRequirements.slreqx#7: SR_3: Hydraulic Actuator Signals
block :21 implements HelicopterSystemRequirements.slreqx#8: SR_4 : Hydraulic Actuator Control Loop Performance
block :21 implements HelicopterSystemRequirements.slreqx#9: SR_5 : Attitude Heading Reference System Interfaces
block :21 implements HelicopterSystemRequirements.slreqx#10: SR_6 : Attitude Rate Tracking Performance
block :21 implements HelicopterSystemRequirements.slreqx#11: SR_7 : Control Bandwidth
block :21 implements HelicopterSystemRequirements.slreqx#12: SR_8 : Control Gain and Phase Margins
block :21 implements HelicopterSystemRequirements.slreqx#13: SR_9 : Attitude Rate Authority Limiting
block :21 implements HelicopterSystemRequirements.slreqx#14: SR_10 : Sensor Validation
block :21 implements HelicopterSystemRequirements.slreqx#15: SR_11 : Sensor Voting
block :24 implements HelicopterSystemRequirements.slreqx#5: SR_1: Pilot Input Signals
block :4 implements HelicopterSystemRequirements.slreqx#9: SR_5 : Attitude Heading Reference System Interfaces
block :7 implements HelicopterSystemRequirements.slreqx#9: SR_5 : Attitude Heading Reference System Interfaces