% Requirement links of Heli_outer_loop.slx (R2019a)

block :1 implements HelicopterSoftwareRequirements.slreqx#5: HLR_1: Pilot Input Signal Processing
block :1 implements HelicopterSoftwareRequirements.slreqx#10: HLR_6: Pitch Outer Loop Control
block :10 implements HelicopterSoftwareRequirements.slreqx#10: HLR_6: Pitch Outer Loop Control
block :11 implements HelicopterSoftwareRequirements.slreqx#11: HLR_7: Roll Outer Loop Control
block :12 implements HelicopterSoftwareRequirements.slreqx#12: HLR_8: Yaw Outer Loop Control
block :14 implements HelicopterSoftwareRequirements.slreqx#10: HLR_6: Pitch Outer Loop Control
block :15 implements HelicopterSoftwareRequirements.slreqx#10: HLR_6: Pitch Outer Loop Control
block :17 implements HelicopterSoftwareRequirements.slreqx#10: HLR_6: Pitch Outer Loop Control
block :18 implements HelicopterSoftwareRequirements.slreqx#10: HLR_6: Pitch Outer Loop Control
block :19 implements HelicopterSoftwareRequirements.slreqx#10: HLR_6: Pitch Outer Loop Control
block :2 implements HelicopterSoftwareRequirements.slreqx#10: HLR_6: Pitch Outer Loop Control
block :20 implements HelicopterSoftwareRequirements.slreqx#11: HLR_7: Roll Outer Loop Control
block :21 implements HelicopterSoftwareRequirements.slreqx#11: HLR_7: Roll Outer Loop Control
block :22 implements HelicopterSoftwareRequirements.slreqx#11: HLR_7: Roll Outer Loop Control
block :23 implements HelicopterSoftwareRequirements.slreqx#11: HLR_7: Roll Outer Loop Control
block :24 implements HelicopterSoftwareRequirements.slreqx#11: HLR_7: Roll Outer Loop Control
block :25 implements HelicopterSoftwareRequirements.slreqx#12: HLR_8: Yaw Outer Loop Control
block :26 implements HelicopterSoftwareRequirements.slreqx#12: HLR_8: Yaw Outer Loop Control
block :27 implements HelicopterSoftwareRequirements.slreqx#12: HLR_8: Yaw Outer Loop Control
block :28 implements HelicopterSoftwareRequirements.slreqx#12: HLR_8: Yaw Outer Loop Control
block :29 implements HelicopterSoftwareRequirements.slreqx#12: HLR_8: Yaw Outer Loop Control
block :3 implements HelicopterSoftwareRequirements.slreqx#14: HLR_10: AHRS Input Signal Processing
block :31 implements HelicopterSoftwareRequirements.slreqx#5: HLR_1: Pilot Input Signal Processing
block :32 implements HelicopterSoftwareRequirements.slreqx#5: HLR_1: Pilot Input Signal Processing
block :33 implements HelicopterSoftwareRequirements.slreqx#5: HLR_1: Pilot Input Signal Processing
block :34 implements HelicopterSoftwareRequirements.slreqx#5: HLR_1: Pilot Input Signal Processing
block :35 implements HelicopterSoftwareRequirements.slreqx#5: HLR_1: Pilot Input Signal Processing
block :36 implements HelicopterSoftwareRequirements.slreqx#5: HLR_1: Pilot Input Signal Processing
block :4 implements HelicopterSoftwareRequirements.slreqx#14: HLR_10: AHRS Input Signal Processing
block :5 implements HelicopterSoftwareRequirements.slreqx#5: HLR_1: Pilot Input Signal Processing
block :5 implements HelicopterSoftwareRequirements.slreqx#11: HLR_7: Roll Outer Loop Control
block :6 implements HelicopterSoftwareRequirements.slreqx#5: HLR_1: Pilot Input Signal Processing
block :6 implements HelicopterSoftwareRequirements.slreqx#12: HLR_8: Yaw Outer Loop Control
block :7 implements HelicopterSoftwareRequirements.slreqx#14: HLR_10: AHRS Input Signal Processing
block :8 implements HelicopterSoftwareRequirements.slreqx#11: HLR_7: Roll Outer Loop Control
block :9 implements HelicopterSoftwareRequirements.slreqx#12: HLR_8: Yaw Outer Loop Control