test file "ActLoopTest"

suite "Actuator Control Test"

  case "ChirpFrequencyResponse" [simulation]
    description: This test case runs a frequency sweep from 0 to 100 Hz to measure bandwidth and damping.
    model ActuatorControlLoop, mode Normal, start time 0, stop time 10
    post-load callback:
      % Create a chirp signal for testing
      t=0:0.001:10;
      y=0.02*chirp(t,0,10,100,'li',270);
      input.Command = timeseries(y,t);
    cleanup callback:
      clearvars t y input;
    custom criteria:
      % Get input signal
      in = test.sltest_simout.get('logsout').get('Input').Values.Command.Data;

      % Get output signal
      out = test.sltest_simout.get('logsout').get('Output').Values.Data;

      % Id the data
      data = iddata(out,in,0.001);

      % Get the second order estimate
      sys = tfest(data,2,0);
      [num, den]=tfdata(sys);

      % Verify gain is 1.0 within 5%
      %test.verifyGreaterThanOrEqual(num{1}(3)/den{1}(3), 0.95);
      %test.verifyLessThanOrEqual(num{1}(3)/den{1}(3), 1.05);

      % Verify bandwidth is at least 10 HZ (62.8319 rad/sec)
      test.verifyGreaterThanOrEqual(sqrt(den{1}(3)), 62.8319);

      % Verify damping is at least 0.4
      test.verifyGreaterThanOrEqual(den{1}(2)/2/sqrt(den{1}(3)), 0.4);

      % Make a bode plot
      opts = bodeoptions;
      opts.FreqUnits='Hz';
      opts.Grid='on';
      bode(sys, opts);

  case "SmallPositiveStep" [simulation]
    description: Thsi test case is a small signal step that verifies the rise time and tracking within 5% of final value.
    model ActuatorControlLoop, stop time 0.5
    post-load callback:
      t=0:0.001:0.5;
      y=zeros(1,501);
      y(1,101:501)=0.02;
      input.Command = timeseries(y,t);
    cleanup callback:
      clearvars t y input;
    custom criteria:
      % Get output signal
      out = test.sltest_simout.get('logsout').get('Output').Values.Data;

      % Verify final tracking is within 5% of 0.02
      % Peak time should occur within .1677 sec after the step (0.1 + 0.1677)
      settledData = out(268:end);
      threshold = 0.05*0.02;
      test.verifyGreaterThanOrEqual(min(settledData), 0.02-threshold);
      test.verifyLessThanOrEqual(max(settledData), 0.02+threshold);

  case "SmallNegativeStep" [simulation]
    description: Thsi test case is a small signal step that verifies the rise time and tracking within 5% of final value.
    model ActuatorControlLoop, stop time 0.5
    post-load callback:
      t=0:0.001:0.5;
      y=zeros(1,501);
      y(1,101:501)=-0.02;
      input.Command = timeseries(y,t);
    cleanup callback:
      clearvars t y input;
    custom criteria:
      % Get output signal
      out = test.sltest_simout.get('logsout').get('Output').Values.Data;

      % Verify final tracking is within 5% of 0.02
      % Peak time should occur within .1677 sec after the step (0.1 + 0.1677)
      settledData = out(268:end);
      threshold = 0.05*0.02;
      test.verifyGreaterThanOrEqual(min(settledData), -0.02-threshold);
      test.verifyLessThanOrEqual(max(settledData), -0.02+threshold);

  case "LargePositiveStep" [simulation]
    description: Thsi test case is a large signal step that verifes tracking within 5% of final full scale value.
    model ActuatorControlLoop, stop time 0.5
    post-load callback:
      t=0:0.001:0.5;
      y=zeros(1,501);
      y(1,101:501)=0.1;
      input.Command = timeseries(y,t);
    cleanup callback:
      clearvars t y input;
    custom criteria:
      % Get output signal
      out = test.sltest_simout.get('logsout').get('Output').Values.Data;

      % Verify final tracking is within 5% of 0.0.1
      % Actuator rate limit is 0.5 m/sec, thus 0.2 sec min to 0.1
      % Transfer function lag is 0.0159
      % Final value should occur within 0.2159 sec after the step (0.1 + 0.2159)
      settledData = out(316:end);
      threshold = 0.05*0.1;
      test.verifyGreaterThanOrEqual(min(settledData), 0.1-threshold);
      test.verifyLessThanOrEqual(max(settledData), 0.1+threshold);

  case "LargeNegativeStep" [simulation]
    description: Thsi test case is a large signal step that verifes tracking within 5% of final full scale value.
    model ActuatorControlLoop, stop time 0.5
    post-load callback:
      t=0:0.001:0.5;
      y=zeros(1,501);
      y(1,101:501)=-0.1;
      input.Command = timeseries(y,t);
    cleanup callback:
      clearvars t y input;
    custom criteria:
      % Get output signal
      out = test.sltest_simout.get('logsout').get('Output').Values.Data;

      % Verify final tracking is within 5% of 0.1
      % Actuator rate limit is 0.5 m/sec, thus 0.2 sec min to 0.1
      % Transfer function lag is 0.0159
      % Final value should occur within 0.2159 sec after the step (0.1 + 0.2159)
      settledData = out(316:end);
      threshold = 0.05*0.1;
      test.verifyGreaterThanOrEqual(min(settledData), -0.1-threshold);
      test.verifyLessThanOrEqual(max(settledData), -0.1+threshold);