% Requirement links of FCC.slx (R2018b)

block :1 implements HelicopterSoftwareRequirements.slreqx#6: HLR_2 : Hydraulic Actuator Feedback
block :13 implements HelicopterSoftwareRequirements.slreqx#5: HLR_1: Pilot Input Signal Processing
block :15 implements HelicopterSoftwareRequirements.slreqx#5: HLR_1: Pilot Input Signal Processing
block :17 implements HelicopterSoftwareRequirements.slreqx#5: HLR_1: Pilot Input Signal Processing
block :19 implements HelicopterSoftwareRequirements.slreqx#14: HLR_10: AHRS Input Signal Processing
block :2 implements HelicopterSoftwareRequirements.slreqx#7: HLR_3: Hydraulic Actuator Drive
block :21 implements HelicopterSoftwareRequirements.slreqx#14: HLR_10: AHRS Input Signal Processing
block :23 implements HelicopterSoftwareRequirements.slreqx#14: HLR_10: AHRS Input Signal Processing
block :28 implements HelicopterSoftwareRequirements.slreqx#9: HLR_5: Multi-Variable Inner Loop Control
block :29 implements HelicopterSoftwareRequirements.slreqx#10: HLR_6: Pitch Outer Loop Control
block :29 implements HelicopterSoftwareRequirements.slreqx#11: HLR_7: Roll Outer Loop Control
block :29 implements HelicopterSoftwareRequirements.slreqx#12: HLR_8: Yaw Outer Loop Control
block :3 implements HelicopterSoftwareRequirements.slreqx#8: HLR_4: Hydraulic Actuator Loop Control
block :31 implements HelicopterSoftwareRequirements.slreqx#13: HLR_9 : AHRS Validity Check
block :31 implements HelicopterSoftwareRequirements.slreqx#15: HLR_11: AHRS Voting for Triple Sensors
block :31 implements HelicopterSoftwareRequirements.slreqx#16: HLR_12: AHRS Voting for Dual Sensors
block :31 implements HelicopterSoftwareRequirements.slreqx#17: HLR_13: AHRS Usage of Single Sensor
block :32 implements HelicopterSoftwareRequirements.slreqx#13: HLR_9 : AHRS Validity Check
block :32 implements HelicopterSoftwareRequirements.slreqx#14: HLR_10: AHRS Input Signal Processing
block :33 implements HelicopterSoftwareRequirements.slreqx#13: HLR_9 : AHRS Validity Check
block :33 implements HelicopterSoftwareRequirements.slreqx#14: HLR_10: AHRS Input Signal Processing
block :34 implements HelicopterSoftwareRequirements.slreqx#13: HLR_9 : AHRS Validity Check
block :34 implements HelicopterSoftwareRequirements.slreqx#14: HLR_10: AHRS Input Signal Processing
block :37 implements HelicopterSoftwareRequirements.slreqx#5: HLR_1: Pilot Input Signal Processing
block :4 implements HelicopterSoftwareRequirements.slreqx#8: HLR_4: Hydraulic Actuator Loop Control
block :42 implements HelicopterSoftwareRequirements.slreqx#5: HLR_1: Pilot Input Signal Processing
block :43 implements HelicopterSoftwareRequirements.slreqx#5: HLR_1: Pilot Input Signal Processing
block :44 implements HelicopterSoftwareRequirements.slreqx#5: HLR_1: Pilot Input Signal Processing
block :45 implements HelicopterSoftwareRequirements.slreqx#5: HLR_1: Pilot Input Signal Processing
block :46 implements HelicopterSoftwareRequirements.slreqx#5: HLR_1: Pilot Input Signal Processing
block :47 implements HelicopterSoftwareRequirements.slreqx#6: HLR_2 : Hydraulic Actuator Feedback
block :48 implements HelicopterSoftwareRequirements.slreqx#6: HLR_2 : Hydraulic Actuator Feedback
block :49 implements HelicopterSoftwareRequirements.slreqx#6: HLR_2 : Hydraulic Actuator Feedback
block :5 implements HelicopterSoftwareRequirements.slreqx#7: HLR_3: Hydraulic Actuator Drive
block :50 implements HelicopterSoftwareRequirements.slreqx#6: HLR_2 : Hydraulic Actuator Feedback
block :51 implements HelicopterSoftwareRequirements.slreqx#6: HLR_2 : Hydraulic Actuator Feedback
block :52 implements HelicopterSoftwareRequirements.slreqx#6: HLR_2 : Hydraulic Actuator Feedback
block :53 implements HelicopterSoftwareRequirements.slreqx#7: HLR_3: Hydraulic Actuator Drive
block :54 implements HelicopterSoftwareRequirements.slreqx#7: HLR_3: Hydraulic Actuator Drive
block :55 implements HelicopterSoftwareRequirements.slreqx#7: HLR_3: Hydraulic Actuator Drive
block :56 implements HelicopterSoftwareRequirements.slreqx#7: HLR_3: Hydraulic Actuator Drive
block :57 implements HelicopterSoftwareRequirements.slreqx#7: HLR_3: Hydraulic Actuator Drive
block :58 implements HelicopterSoftwareRequirements.slreqx#7: HLR_3: Hydraulic Actuator Drive
block :6 implements HelicopterSoftwareRequirements.slreqx#8: HLR_4: Hydraulic Actuator Loop Control
block :7 implements HelicopterSoftwareRequirements.slreqx#7: HLR_3: Hydraulic Actuator Drive
block :8 implements HelicopterSoftwareRequirements.slreqx#6: HLR_2 : Hydraulic Actuator Feedback
block :9 implements HelicopterSoftwareRequirements.slreqx#6: HLR_2 : Hydraulic Actuator Feedback