% Requirement links of AHRS_voter.slx (R2018b)

block :1 implements HelicopterSoftwareRequirements.slreqx#14: HLR_10: AHRS Input Signal Processing
block :10 implements HelicopterSoftwareRequirements.slreqx#13: HLR_9 : AHRS Validity Check
block :10 implements HelicopterSoftwareRequirements.slreqx#14: HLR_10: AHRS Input Signal Processing
block :11 implements HelicopterSoftwareRequirements.slreqx#13: HLR_9 : AHRS Validity Check
block :11 implements HelicopterSoftwareRequirements.slreqx#14: HLR_10: AHRS Input Signal Processing
block :12 implements HelicopterSoftwareRequirements.slreqx#15: HLR_11: AHRS Voting for Triple Sensors
block :13 implements HelicopterSoftwareRequirements.slreqx#15: HLR_11: AHRS Voting for Triple Sensors
block :14 implements HelicopterSoftwareRequirements.slreqx#15: HLR_11: AHRS Voting for Triple Sensors
block :15 implements HelicopterSoftwareRequirements.slreqx#15: HLR_11: AHRS Voting for Triple Sensors
block :16 implements HelicopterSoftwareRequirements.slreqx#15: HLR_11: AHRS Voting for Triple Sensors
block :17 implements HelicopterSoftwareRequirements.slreqx#16: HLR_12: AHRS Voting for Dual Sensors
block :18 implements HelicopterSoftwareRequirements.slreqx#16: HLR_12: AHRS Voting for Dual Sensors
block :19 implements HelicopterSoftwareRequirements.slreqx#16: HLR_12: AHRS Voting for Dual Sensors
block :2 implements HelicopterSoftwareRequirements.slreqx#15: HLR_11: AHRS Voting for Triple Sensors
block :2 implements HelicopterSoftwareRequirements.slreqx#16: HLR_12: AHRS Voting for Dual Sensors
block :2 implements HelicopterSoftwareRequirements.slreqx#17: HLR_13: AHRS Usage of Single Sensor
block :20 implements HelicopterSoftwareRequirements.slreqx#16: HLR_12: AHRS Voting for Dual Sensors
block :25 implements HelicopterSoftwareRequirements.slreqx#16: HLR_12: AHRS Voting for Dual Sensors
block :26 implements HelicopterSoftwareRequirements.slreqx#16: HLR_12: AHRS Voting for Dual Sensors
block :27 implements HelicopterSoftwareRequirements.slreqx#16: HLR_12: AHRS Voting for Dual Sensors
block :28 implements HelicopterSoftwareRequirements.slreqx#16: HLR_12: AHRS Voting for Dual Sensors
block :29 implements HelicopterSoftwareRequirements.slreqx#16: HLR_12: AHRS Voting for Dual Sensors
block :3 implements HelicopterSoftwareRequirements.slreqx#14: HLR_10: AHRS Input Signal Processing
block :30 implements HelicopterSoftwareRequirements.slreqx#16: HLR_12: AHRS Voting for Dual Sensors
block :31 implements HelicopterSoftwareRequirements.slreqx#16: HLR_12: AHRS Voting for Dual Sensors
block :32 implements HelicopterSoftwareRequirements.slreqx#16: HLR_12: AHRS Voting for Dual Sensors
block :33 implements HelicopterSoftwareRequirements.slreqx#16: HLR_12: AHRS Voting for Dual Sensors
block :34 implements HelicopterSoftwareRequirements.slreqx#16: HLR_12: AHRS Voting for Dual Sensors
block :35 implements HelicopterSoftwareRequirements.slreqx#17: HLR_13: AHRS Usage of Single Sensor
block :36 implements HelicopterSoftwareRequirements.slreqx#17: HLR_13: AHRS Usage of Single Sensor
block :37 implements HelicopterSoftwareRequirements.slreqx#17: HLR_13: AHRS Usage of Single Sensor
block :38 implements HelicopterSoftwareRequirements.slreqx#17: HLR_13: AHRS Usage of Single Sensor
block :39 implements HelicopterSoftwareRequirements.slreqx#17: HLR_13: AHRS Usage of Single Sensor
block :4 implements HelicopterSoftwareRequirements.slreqx#14: HLR_10: AHRS Input Signal Processing
block :40 implements HelicopterSoftwareRequirements.slreqx#17: HLR_13: AHRS Usage of Single Sensor
block :41 implements HelicopterSoftwareRequirements.slreqx#17: HLR_13: AHRS Usage of Single Sensor
block :42 implements HelicopterSoftwareRequirements.slreqx#17: HLR_13: AHRS Usage of Single Sensor
block :44 implements HelicopterSoftwareRequirements.slreqx#17: HLR_13: AHRS Usage of Single Sensor
block :45 implements HelicopterSoftwareRequirements.slreqx#17: HLR_13: AHRS Usage of Single Sensor
block :46 implements HelicopterSoftwareRequirements.slreqx#17: HLR_13: AHRS Usage of Single Sensor
block :47 implements HelicopterSoftwareRequirements.slreqx#17: HLR_13: AHRS Usage of Single Sensor
block :48 implements HelicopterSoftwareRequirements.slreqx#17: HLR_13: AHRS Usage of Single Sensor
block :49 implements HelicopterSoftwareRequirements.slreqx#13: HLR_9 : AHRS Validity Check
block :49 implements HelicopterSoftwareRequirements.slreqx#15: HLR_11: AHRS Voting for Triple Sensors
block :49 implements HelicopterSoftwareRequirements.slreqx#16: HLR_12: AHRS Voting for Dual Sensors
block :49 implements HelicopterSoftwareRequirements.slreqx#17: HLR_13: AHRS Usage of Single Sensor
block :5 implements HelicopterSoftwareRequirements.slreqx#15: HLR_11: AHRS Voting for Triple Sensors
block :50 implements HelicopterSoftwareRequirements.slreqx#13: HLR_9 : AHRS Validity Check
block :6 implements HelicopterSoftwareRequirements.slreqx#15: HLR_11: AHRS Voting for Triple Sensors
block :7 implements HelicopterSoftwareRequirements.slreqx#15: HLR_11: AHRS Voting for Triple Sensors
block :8 implements HelicopterSoftwareRequirements.slreqx#15: HLR_11: AHRS Voting for Triple Sensors
block :9 implements HelicopterSoftwareRequirements.slreqx#13: HLR_9 : AHRS Validity Check
block :9 implements HelicopterSoftwareRequirements.slreqx#14: HLR_10: AHRS Input Signal Processing