% Requirement links of AHRS_voter_REQ_Based_Test.mldatx (R2017b)

item 1 links to HelicopterSoftwareRequirements.slreqx#15: HLR_11: AHRS Voting for Triple Sensors
item 1 links to HelicopterSoftwareRequirements.slreqx#13: HLR_9 : AHRS Validity Check
item 2 links to HelicopterSoftwareRequirements.slreqx#17: HLR_13: AHRS Usage of Single Sensor
item 2 links to HelicopterSoftwareRequirements.slreqx#13: HLR_9 : AHRS Validity Check
item 3 links to HelicopterSoftwareRequirements.slreqx#16: HLR_12: AHRS Voting for Dual Sensors
item 3 links to HelicopterSoftwareRequirements.slreqx#13: HLR_9 : AHRS Validity Check