test file "LandingGearMode_Test"

suite "RequirementBasedTest"

  case "Both Locked" [baseline]
    description: Requirement Based Test with Derived Test Cases from Coverage Analysis
    model LandingGearMode, harness LandingGearMode_DerivedTestCases
    signal scenario: Bothlocked

  case "One Locked Case A" [baseline]
    description: Requirement Based Test with Derived Test Cases from Coverage Analysis
    model LandingGearMode, harness LandingGearMode_DerivedTestCases
    signal scenario: OneLockedA

  case "One Locked Case B" [baseline]
    description: Requirement Based Test with Derived Test Cases from Coverage Analysis
    model LandingGearMode, harness LandingGearMode_DerivedTestCases
    signal scenario: OneLockedB

  case "Both UnLocked" [baseline]
    description: Requirement Based Test with Derived Test Cases from Coverage Analysis
    model LandingGearMode, harness LandingGearMode_DerivedTestCases
    signal scenario: BothUnlocked

  case "Unlocked to Left Locked" [baseline]
    description: Requirement Based Test with Derived Test Cases from Coverage Analysis
    model LandingGearMode, harness LandingGearMode_DerivedTestCases
    signal scenario: Unlocked2LeftLocked

  case "Unlocked to Right Locked" [baseline]
    description: Requirement Based Test with Derived Test Cases from Coverage Analysis
    model LandingGearMode, harness LandingGearMode_DerivedTestCases
    signal scenario: Unlocked2RightLocked

  case "Locked to Left Unlocked" [baseline]
    description: Requirement Based Test with Derived Test Cases from Coverage Analysis
    model LandingGearMode, harness LandingGearMode_DerivedTestCases
    signal scenario: Locked2LeftUnlocked

  case "Locked to Right Unlocked" [baseline]
    description: Requirement Based Test with Derived Test Cases from Coverage Analysis
    model LandingGearMode, harness LandingGearMode_DerivedTestCases
    signal scenario: Locked2RightUnlocked

suite "EquivalenceTest (SIL)"

  case "Both Locked" [equivalence]
    simulation 1:
      model LandingGearMode, harness LandingGearMode_DerivedTestCases
      signal scenario: Bothlocked
    simulation 2:
      model LandingGearMode, harness LandingGearMode_Harness_SIL
      signal scenario: Bothlocked

  case "One Locked Case A" [equivalence]
    simulation 1:
      model LandingGearMode, harness LandingGearMode_DerivedTestCases
      signal scenario: OneLockedA
    simulation 2:
      model LandingGearMode, harness LandingGearMode_Harness_SIL
      signal scenario: OneLockedA

  case "One Locked Case B" [equivalence]
    simulation 1:
      model LandingGearMode, harness LandingGearMode_DerivedTestCases
      signal scenario: OneLockedA
    simulation 2:
      model LandingGearMode, harness LandingGearMode_Harness_SIL
      signal scenario: OneLockedA

  case "Both UnLocked" [equivalence]
    simulation 1:
      model LandingGearMode, harness LandingGearMode_DerivedTestCases
      signal scenario: BothUnlocked
    simulation 2:
      model LandingGearMode, harness LandingGearMode_Harness_SIL
      signal scenario: BothUnlocked

  case "Unlocked to Left Locked" [equivalence]
    simulation 1:
      model LandingGearMode, harness LandingGearMode_DerivedTestCases
      signal scenario: Unlocked2LeftLocked
    simulation 2:
      model LandingGearMode, harness LandingGearMode_Harness_SIL
      signal scenario: Unlocked2LeftLocked

  case "Unlocked to Right Locked" [equivalence]
    simulation 1:
      model LandingGearMode, harness LandingGearMode_DerivedTestCases
      signal scenario: Unlocked2RightLocked
    simulation 2:
      model LandingGearMode, harness LandingGearMode_Harness_SIL
      signal scenario: Unlocked2RightLocked

  case "Locked to Left Unlocked" [equivalence]
    simulation 1:
      model LandingGearMode, harness LandingGearMode_DerivedTestCases
      signal scenario: Locked2LeftUnlocked
    simulation 2:
      model LandingGearMode, harness LandingGearMode_Harness_SIL
      signal scenario: Locked2LeftUnlocked

  case "Locked to Right Unlocked" [equivalence]
    simulation 1:
      model LandingGearMode, harness LandingGearMode_DerivedTestCases
      signal scenario: Locked2RightUnlocked
    simulation 2:
      model LandingGearMode, harness LandingGearMode_Harness_SIL
      signal scenario: Locked2RightUnlocked